# Grasshopper definition grasshopper_file.gh (Grasshopper 1.0.7)

random_number_upper_bound = Slider(11, range=0..40)
random_number_lower_bound = Slider(5, range=0..40)
height_of_vertical_panels = Slider(6, range=0..40)
# The following properties can be edited by the user:
# - Length of the base
# - Height of the base
# - Notch size (cardboard thickness)
# - Width/height of vertical panels
# - Point distribution of the wave
# - Random number lower/upper bound and seed
width_of_vertical_panels = Slider(10, range=0..40)
random_number_seed = Slider(13, range=0..40)
point_distribution = Slider(5, range=0..40)
length_of_base = Slider(15, range=0..100)
height_of_base = Slider(3, range=0..40)
notch_size_in = Slider(0.17, range=0..1)
panel = Panel("Wave generation")
panel_2 = Panel("Base + panel generation")
xz_plane = XZPlane(Origin=Point(0, 0, 0))
construct_domain = ConstructDomain(DomainStart=random_number_lower_bound, DomainEnd=random_number_upper_bound)
plane = Plane(PlaneXY(0, 0, 0))
division = Division(A=width_of_vertical_panels, B=4)
rectangle = Rectangle(Plane=xz_plane, XSize=width_of_vertical_panels, YSize=length_of_base, Radius=0)  # -> Rectangle, Length
multiplication = Multiplication(A=notch_size_in, B=3)
rectangle_2 = Rectangle(Plane=plane, XSize=length_of_base, YSize=height_of_base, Radius=0)  # -> Rectangle, Length
divide_surface = DivideSurface(Surface=rectangle.Rectangle, UCount=point_distribution, VCount=point_distribution)  # -> flatten(Points), flatten(Normals), Parameters
vector_xyz = VectorXYZ(XComponent=division, YComponent=0, ZComponent=0)  # -> Vector, Length
vector_xyz_2 = VectorXYZ(XComponent=multiplication, YComponent=0, ZComponent=0)  # -> Vector, Length
division_2 = Division(A=height_of_base, B=1.9)
division_3 = Division(A=length_of_base, B=multiplication)
list_length = ListLength(List=divide_surface.Points)
random = Random(Range=construct_domain, Number=list_length, Seed=random_number_seed)
rectangle_3 = Rectangle(Plane=PlaneXY(0, 0, 0), XSize=notch_size_in, YSize=division_2, Radius=0)  # -> Rectangle, Length
subtraction = Subtraction(A=multiplication, B=notch_size_in)
amplitude = Amplitude(Vector=divide_surface.Normals, Amplitude=random)
vector_xyz_3 = VectorXYZ(XComponent=0, YComponent=height_of_vertical_panels, ZComponent=0)  # -> Vector, Length
move = Move(Geometry=rectangle_3.Rectangle, Motion=vector_xyz.Vector)  # -> Geometry, Transform
vector_xyz_4 = VectorXYZ(XComponent=subtraction, YComponent=division_2, ZComponent=0)  # -> Vector, Length
rectangle_4 = Rectangle(Plane=PlaneXY(0, 0, 0), XSize=notch_size_in, YSize=division_2, Radius=0)  # -> Rectangle, Length
move_2 = Move(Geometry=divide_surface.Points, Motion=amplitude)  # -> Geometry, Transform
addition = Addition(A=point_distribution, B="1")
move_3 = Move(Geometry=rectangle_4.Rectangle, Motion=vector_xyz_4.Vector)  # -> Geometry, Transform
linear_array = LinearArray(Geometry=move.Geometry, Direction=vector_xyz.Vector, Count=3)  # -> Geometry, Transform
rectangle_5 = Rectangle(Plane=PlaneXY(0, 0, 0), XSize=width_of_vertical_panels, YSize=height_of_vertical_panels, Radius=0)  # -> Rectangle, Length
division_4 = Division(A=length_of_base, B=division_3)
surface_from_points = SurfaceFromPoints(Points=move_2.Geometry, UCount=addition, Interpolate=False)  # -> flatten(Surface)
linear_array_2 = LinearArray(Geometry=move_3.Geometry, Direction=vector_xyz_2.Vector, Count=division_3)  # -> Geometry, Transform
vector_xyz_5 = VectorXYZ(XComponent=0, YComponent=0, ZComponent=division_4)  # -> Vector, Length
extrude = Extrude(Base=surface_from_points, Direction=vector_xyz_3.Vector)
move_4 = Move(Geometry=linear_array.Geometry, Motion=Vector(0, -12.1, 0))  # -> Geometry, Transform
move_5 = Move(Geometry=rectangle_5.Rectangle, Motion=Vector(0, -12, 0))  # -> Geometry, Transform
trim_with_regions = TrimWithRegions(Curve=linear_array_2.Geometry, Regions=rectangle_2.Rectangle)  # -> flatten(Inside), Outside
trim_with_regions_2 = TrimWithRegions(Curve=rectangle_2.Rectangle, Regions=linear_array_2.Geometry)  # -> Inside, Outside
join_curves = JoinCurves(Curves=[trim_with_regions.Inside, trim_with_regions_2.Outside], Preserve=False)
# Intersection wave and panels
linear_array_3 = LinearArray(Geometry=move_5.Geometry, Direction=vector_xyz_5.Vector, Count=division_3)  # -> flatten(Geometry), Transform
brep_plane = BrepPlane(Brep=surface_from_points, Plane=linear_array_3.Geometry)  # -> flatten(Curves), Points
linear_array_4 = LinearArray(Geometry=move_4.Geometry, Direction=vector_xyz_5.Vector, Count=division_3)  # -> flatten(Geometry), Transform
trim_with_breps = TrimWithBreps(Curve=linear_array_3.Geometry, Brep=extrude)  # -> Inside, flatten(Outside)
trim_with_regions_3 = TrimWithRegions(Curve=brep_plane.Curves, Regions=move_5.Geometry)  # -> flatten(Inside), Outside
join_curves_2 = JoinCurves(Curves=flatten([trim_with_regions_3.Inside, trim_with_breps.Outside]), Preserve=False)  # -> flatten(Curves)
trim_with_regions_4 = TrimWithRegions(Curve=join_curves_2, Regions=linear_array_4.Geometry)  # -> Inside, flatten(Outside)
trim_with_regions_5 = TrimWithRegions(Curve=linear_array_4.Geometry, Regions=join_curves_2)  # -> flatten(Inside), Outside
join_curves_3 = JoinCurves(Curves=[trim_with_regions_4.Outside, trim_with_regions_5.Inside], Preserve=False)  # -> flatten(Curves)
move_to_plane = MoveToPlane(Geometry=join_curves_3, Plane=PlaneXY(0, 0, 0), Above=True, Below=True)  # -> Geometry, Transform
